# Dynamo graph 01_Level_Filtered_Element_Collector.dyn "exxercise1" (Dynamo 4.0.2.3852)

python_script = Python()  # PythonNet3; unwired: IN[0]
# ---------- python_script.python (56 lines) ----------
import clr
clr.AddReference('RevitAPI')
clr.AddReference('RevitServices')

import Autodesk
from Autodesk.Revit.DB import  *
from RevitServices.Persistence import DocumentManager

doc=DocumentManager.Instance.CurrentDBDocument

level='01 - Entry Level'

all_levels = FilteredElementCollector(doc) \
    .OfClass(Level) \
    .WhereElementIsNotElementType() \
    .ToElements()

level_1=None

for lvl in all_levels:
    if lvl.Name==level:
        level_1=lvl.Id
        break
        
if level_1:
    level_filter=ElementLevelFilter(level_1)
    level_cols=FilteredElementCollector(doc) \
    .OfCategory(BuiltInCategory.OST_StructuralColumns) \
    .WherePasses(level_filter) \
    .WhereElementIsNotElementType() \
    .ToElements()
    
    col_details=[]
    total_vol=0.0
    
    for col in level_cols:
        colId=col.Id.ToString()
        vol_param=col.LookupParameter('Volume')
        vol_ft3=vol_param.AsDouble() if vol_param else 0.0
        vol_m3=vol_ft3 * 0.0283168
        total_vol+=vol_m3
        
        col_details.append(f"ID: {colId} | Vol: {vol_m3:.2f} m3")
    
    summary_output = (
        f" Level Filter Audit: '{level}' \n"
        f"• Columns Found on {level}: {len(level_cols)}\n"
        f"• Total Concrete Volume on Floor: {total_vol:.2f} m3\n\n"
        f"Sample Elements:\n" + "\n".join(col_details[:5])  # Show first 5
    )
        
else:
     summary_output = f"ERROR: Level '{level}' was not found in the model."
     
OUT=summary_output 
   
# ----------------------------------------
watch = Watch(python_script)
