# Dynamo graph 02_Structural_Volume_Calculator.dyn "exxercise2" (Dynamo 4.0.2.3852)

python_script = Python()  # PythonNet3; unwired: IN[0]
# ---------- python_script.python (53 lines) ----------
import clr
clr.AddReference('RevitAPI')
clr.AddReference('RevitServices')

from Autodesk.Revit.DB import *
from RevitServices.Persistence import DocumentManager

doc=DocumentManager.Instance.CurrentDBDocument

cols=FilteredElementCollector(doc) \
.OfCategory(BuiltInCategory.OST_StructuralColumns) \
.WhereElementIsNotElementType() \
.ToElements()

total_vol_cols=0.0

for c in cols:
    vol_param = c.LookupParameter('Volume')
    vol_ft3 = vol_param.AsDouble() if vol_param else 0.0
    vol_m3 = vol_ft3 * 0.0283168
    total_vol_cols += vol_m3

beams=FilteredElementCollector(doc) \
.OfCategory(BuiltInCategory.OST_StructuralFraming) \
.WhereElementIsNotElementType() \
.ToElements()

total_vol_beams = 0.0

for b in beams:
    bvol_param = b.LookupParameter('Volume')
    bvol_ft3 = bvol_param.AsDouble() if bvol_param else 0.0
    bvol_m3 = bvol_ft3 * 0.0283168
    total_vol_beams += bvol_m3


footings=FilteredElementCollector(doc) \
.OfCategory(BuiltInCategory.OST_StructuralFoundation) \
.WhereElementIsNotElementType() \
.ToElements()

total_vol_foot = 0.0

for f in footings:
    fvol_param = f.LookupParameter('Volume')
    fvol_ft3 = fvol_param.AsDouble() if fvol_param else 0.0
    fvol_m3 = fvol_ft3 * 0.0283168
    total_vol_foot += fvol_m3


total_vol = total_vol_cols + total_vol_beams + total_vol_foot

OUT= f"Total Volume: {total_vol:.2f} m3"
# ----------------------------------------
watch = Watch(python_script)
