# Dynamo graph 03_Missing_Parameters_Audit.dyn "exercise3" (Dynamo 4.0.2.3852)

python_script = Python()  # PythonNet3; unwired: IN[0]
# ---------- python_script.python (46 lines) ----------
import clr

clr.AddReference('RevitAPI')
clr.AddReference('RevitServices')

import Autodesk
from Autodesk.Revit.DB import *
from RevitServices.Persistence import DocumentManager

doc=DocumentManager.Instance.CurrentDBDocument

beam=FilteredElementCollector(doc) \
.OfCategory(BuiltInCategory.OST_StructuralFraming) \
.WhereElementIsNotElementType() \
.ToElements()

unmarked_count=0
audit=[]

t=Transaction(doc, 'Beam QA/QC Audit')
t.Start()

for b in beam:
    mark_param=b.LookupParameter('Mark')
    mark_val=mark_param.AsString() if mark_param else None
    comment_param=b.LookupParameter('Comments')
    
    if not mark_val or mark_val.strip()=="":
        unmarked_count+=1
        status='QA/QC Warning: Missing Mark ID'
        
        if comment_param and not comment_param.IsReadOnly:
            comment_param.Set(status)
            
        audit.append(f'BeamId: {b.Id.ToString()} -> Flagged(No mark)')
       
t.Commit

summary= (
    f"=== Beam QA/QC Identification Audit ===\n"
    f"• Total Beams Inspected: {len(beam)}\n"
    f"• Beams Missing Mark IDs: {unmarked_count}\n\n"
    f"First 5 Flagged Items:\n" + "\n".join(audit[:5])
)

OUT =summary
# ----------------------------------------
watch = Watch(python_script)
