# Dynamo graph 04_Column_Height_Compliance_Checker.dyn "exercise5" (Dynamo 4.0.2.3852)

python_script = Python()  # PythonNet3; unwired: IN[0]
# ---------- python_script.python (41 lines) ----------
import clr
clr.AddReference('RevitAPI')
clr.AddReference('RevitServices')

from Autodesk.Revit.DB import *
from RevitServices.Persistence import DocumentManager

doc=DocumentManager.Instance.CurrentDBDocument

cols=FilteredElementCollector(doc) \
.OfCategory(BuiltInCategory.OST_StructuralColumns) \
.WhereElementIsNotElementType() \
.ToElements()

tallcolcount=0
audit=[]
maxht=4.5

for c in cols:
    bbox=c.get_BoundingBox(None)
    if bbox:
        htinft=bbox.Max.Z-bbox.Min.Z
        htinm=htinft*0.3048
        
        colId=c.Id.ToString()
        
        if htinm>maxht:
            tallcolcount+=1
            status='Flagged: Height {htinm:.2f} m'
        else:
            status='Pass: Height {htinm:.2f} m ie. under 4.5m'
            
        audit.append(f'Id: {colId} | Height: {htinm:.2f} m | Status: {status}')
        
summary=(f'Height Audit\n'
f'Total Columns Evaluated: {len(cols)} \n'
f'Columns Exceeding Max Height : {tallcolcount} \n'
f'Sample Column Dimension: \n' +'\n'.join(audit[:5])
)

OUT=summary
# ----------------------------------------
watch = Watch(python_script)
