# Dynamo graph 05_Model_Audit_Excel_Exporter.dyn "exercise5code.csv" (Dynamo 4.0.2.3852)

python_script = Python()  # PythonNet3; unwired: IN[0]
# ---------- python_script.python (47 lines) ----------
import clr
import csv

clr.AddReference('RevitAPI')
clr.AddReference('RevitServices')

from Autodesk.Revit.DB import *
from RevitServices.Persistence import DocumentManager

doc=DocumentManager.Instance.CurrentDBDocument

col=FilteredElementCollector(doc) \
.OfCategory(BuiltInCategory.OST_StructuralColumns) \
.WhereElementIsNotElementType() \
.ToElements()

flagged_count=0

path=r'C:\Users\yogen\Desktop\Dynamo  Exercise\exercise5.csv'

with open(path, mode='w', newline='') as f:
    writer=csv.writer(f)
    writer.writerow(['Element ID',  'Level', 'Length', 'Volume', 'QA/QC Status'])
    
    for c in col:
        colId=c.Id.ToString()
        level=c.LookupParameter('Base Level')
        level_name=level.AsValueString() if level else 'Unknown Level'
        
        length_param=c.LookupParameter('System Length')
        length_ft=length_param.AsDouble() if length_param else 0.0
        length_m=length_ft * 0.3048
        
        vol_param=c.LookupParameter('Volume')
        vol_ft=vol_param.AsDouble() if vol_param else 0.0
        vol_m3=vol_ft * 0.0283168
        
        if length_m > 4:
            status='Warning: Exceed 4m Transport Limit'
            flagged_count+=1
        else:
            status='Pass: Approved Length'
            
        writer.writerow([colId, level_name, length_m, vol_m3, status])
    
OUT= f'Successfully saved on folder'
  
# ----------------------------------------
watch = Watch(python_script)
