# Dynamo graph 06_CSV_Parameter_Sync_Importer.dyn "exercise6" (Dynamo 4.0.2.3852)

python_script = Python()  # PythonNet3; unwired: IN[0]
# ---------- python_script.python (67 lines) ----------
import clr
import csv

clr.AddReference('RevitAPI')
clr.AddReference('RevitServices')

from Autodesk.Revit.DB import *
from RevitServices.Persistence import DocumentManager

doc = DocumentManager.Instance.CurrentDBDocument

updated_count = 0
failed_count = 0
sync_log = []

path = r'C:\Users\yogen\Desktop\Dynamo  Exercise\exercise5.csv'

t = Transaction(doc, 'Import Changes from csv file')
t.Start()

try:
    with open(path, mode='r') as f:
        reader = csv.reader(f)
        header = next(reader, None) 
        
        for row in reader:
            if not row or len(row) < 5:
                continue
                
            rowId = row[0].strip()
            status = row[4].strip() 
            
            try:
                elemId = ElementId(int(rowId))
                elem = doc.GetElement(elemId)
                
                if elem:
                    comments_param = elem.LookupParameter("Comments")
                    
                    if comments_param and not comments_param.IsReadOnly:
                        comments_param.Set(status)
                        updated_count += 1
                        sync_log.append(f"Synced ID {rowId} -> '{status}'") 
                    else:
                        failed_count += 1
                else:
                    failed_count += 1
                    
            except Exception:
                failed_count += 1

    t.Commit()
    status_msg = f"SUCCESS: Synced {updated_count} elements from CSV to Revit."

except Exception as file_err:
    t.RollBack()  
    status_msg = f"ERROR reading file: {str(file_err)}"

summary_output = (
    f"=== CSV to Revit Sync Summary ===\n"
    f"• Status: {status_msg}\n"
    f"• Successfully Updated: {updated_count} elements\n"
    f"• Failed/Skipped: {failed_count} elements\n\n"
    f"Sample Updates:\n" + "\n".join(sync_log[:5])
)

OUT = summary_output
# ----------------------------------------
watch = Watch(python_script)
