# Dynamo graph 08_Column_QAQC_Auditor.dyn "py1" (Dynamo 4.0.2.3852)

python_script = Python()  # PythonNet3; unwired: IN[0]
# ---------- python_script.python (62 lines) ----------
# Step 1 - Write boilerplate code
import clr

clr.AddReference('RevitAPI')
clr.AddReference('RevitServices')

from Autodesk.Revit.DB import *
from RevitServices.Persistence import DocumentManager
from RevitServices.Transactions import TransactionManager

# Step 2 - Get all columns
doc = DocumentManager.Instance.CurrentDBDocument

columns = FilteredElementCollector(doc) \
            .OfCategory(BuiltInCategory.OST_StructuralColumns) \
            .WhereElementIsNotElementType() \
            .ToElements()

audit_results = []
total_concrete_volume_m3 = 0.0
flagged_count = 0

# Step 3 - Write QA/QC rules
t = Transaction(doc, "QAQC Column Audit")
t.Start()

for col in columns:
    level_param = col.LookupParameter("Base Level")
    level_name = level_param.AsValueString() if level_param else "Unknown level"
    
    length_param = col.LookupParameter("System Length")
    length_ft = length_param.AsDouble() if length_param else 0.0
    length_m = length_ft * 0.3048
    
    vol_param = col.LookupParameter("Volume")
    vol_ft = vol_param.AsDouble() if vol_param else 0.0
    vol_m3 = vol_ft * 0.0283168
    total_concrete_volume_m3 += vol_m3
    
    comments_param = col.LookupParameter("Comments")
    
    if length_m > 6.0:
        status = f"Warning: Exceed 6m transport limit ({length_m:.2f} m)"
        flagged_count += 1
    else:
        status = "Pass: Approved Length"
        
    if comments_param and not comments_param.IsReadOnly:
        comments_param.Set(status)
        
    audit_results.append([col.Id.ToString(), level_name, round(length_m, 2), status])

t.Commit()

# Step 4 - Output generation
summary_text = (
    f"Total Columns = {len(columns)}\n"
    f"Flagged Columns (>6m) = {flagged_count}\n"
    f"Total Concrete Volume = {total_concrete_volume_m3:.2f} m3"
)

OUT = summary_text
# ----------------------------------------
watch = Watch(python_script)
