# Dynamo graph 01_Rebar_Type_Collector.dyn "1rebarexercise" (Dynamo 4.0.2.3852)

select_model_element = DSModelElementSelection()  # 1 picked in the model
python_script = Python(IN[0]=select_model_element)  # PythonNet3
# ---------- python_script.python (56 lines) ----------
import clr

clr.AddReference('RevitAPI')
from Autodesk.Revit.DB import *
from Autodesk.Revit.DB.Structure import *

clr.AddReference('RevitServices')
from RevitServices.Persistence import DocumentManager
doc=DocumentManager.Instance.CurrentDBDocument

selectedItem = IN[0]
host = UnwrapElement(selectedItem)

output=[]

if host is None:
    output.append('No Element Selected. Select a concrete Column or beam')
else:
    output.append('Host Information')
    output.append('Host Element Id :{}'.format(host.Id.ToString()))
    output.append('Category: {}'.format(host.Category.Name))


covertop=host.LookupParameter('Clear Cover - Top Face')
coverbottom=host.LookupParameter('Clear Cover - Bottom Face')
coverother=host.LookupParameter('Clear Cover - Other Faces')

def get_cover_mm(param):
    if param and param.AsDouble() > 0:
        return round (param.AsDouble() * 304.8, 1)
    return 'Default'

output.append('Top Cover : {} mm'.format(get_cover_mm(covertop)))
output.append('Bottom Cover : {} mm'.format(get_cover_mm(coverbottom)))
output.append('Other Faces Cover : {} mm'.format(get_cover_mm(coverother)))

rebar_collector=FilteredElementCollector(doc) \
.OfClass(RebarBarType) \
.WhereElementIsElementType() \
.ToElements()

output.append('Available Rebar sizes in document')

if len(rebar_collector) == 0:
    output.append('No rebar types loaded')
else:
    for b in rebar_collector:
        barname=b.get_Parameter(BuiltInParameter.ALL_MODEL_TYPE_NAME).AsString()
        bardia_ft=b.BarNominalDiameter
        bardia_mm = round (bardia_ft*304.8,1)
        
        output.append('Type {} | Diameter {} | Id: {}'.format(barname, bardia_mm, b.Id.ToString()))
        


OUT=output
# ----------------------------------------
watch = Watch(python_script)
