# Dynamo graph 02_Bounding_Box_Extraction.dyn "2rebarexercise" (Dynamo 4.0.2.3852)

select_model_element = DSModelElementSelection()  # 1 picked in the model
python_script = Python(IN[0]=select_model_element)  # PythonNet3
# ---------- python_script.python (63 lines) ----------
import clr
from System.Collections.Generic import List

clr.AddReference('RevitAPI')
import Autodesk.Revit.DB as DB
import Autodesk.Revit.DB.Structure as DBStruct

clr.AddReference('RevitServices')
from RevitServices.Persistence import DocumentManager
from RevitServices.Transactions import TransactionManager

doc=DocumentManager.Instance.CurrentDBDocument

host=UnwrapElement(IN[0])

if not host:
    OUT='Please Select host'
else:
    rebar_type=DB.FilteredElementCollector(doc) \
    .OfClass(DBStruct.RebarBarType) \
    .WhereElementIsElementType() \
    .FirstElement()

    bbox=host.get_BoundingBox(None)
    ptmin=bbox.Min
    ptmax=bbox.Max

    cover_ft = 40.0/304.8

    start_x = ptmin.X + cover_ft
    start_y = ptmin.Y + cover_ft
    start_z=ptmin.Z + cover_ft

    end_x=start_x
    end_y=start_y
    end_z=ptmax.Z - cover_ft

    p1=DB.XYZ(start_x, start_y, start_z)
    p2=DB.XYZ(end_x, end_y, end_z)

    barline=DB.Line.CreateBound(p1,p2)
    curves=List[DB.Curve]()
    curves.Add(barline)
    norm=DB.XYZ(1,0,0)

    bar_terminates = DBStruct.BarTerminationsData(doc)
    TransactionManager.Instance.EnsureInTransaction(doc)
    new_rebar=DBStruct.Rebar.CreateFromCurves(
    doc,
    DBStruct.RebarStyle.Standard,
    rebar_type,
    host,
    norm,
    curves,
    bar_terminates,
    True,
    True
    )
    
    TransactionManager.Instance.TransactionTaskDone()
    
    OUT = "SUCCESS: Created Rebar ID: {}".format(new_rebar.Id.ToString())
    
# ----------------------------------------
watch = Watch(python_script)
