# Dynamo graph 03_Generating_Longitudinal_Bar_Lines.dyn "3rebarexercise" (Dynamo 4.0.2.3852)

select_model_element = DSModelElementSelection()  # 1 picked in the model
python_script = Python(IN[0]=select_model_element)  # PythonNet3
# ---------- python_script.python (79 lines) ----------
import clr
from System.Collections.Generic import  List

clr.AddReference('RevitAPI')
import Autodesk.Revit.DB as DB
import Autodesk.Revit.DB.Structure as DBStruct

clr.AddReference('RevitServices')
from RevitServices.Persistence import DocumentManager
from RevitServices.Transactions import TransactionManager

doc=DocumentManager.Instance.CurrentDBDocument

host=UnwrapElement(IN[0])

if not host:
    OUT='Error: Please select a column'
else:
    rebar_type=DB.FilteredElementCollector(doc) \
    .OfClass(DBStruct.RebarBarType) \
    .WhereElementIsElementType() \
    .FirstElement()
    
    if not rebar_type:
        OUT='No Rebar Bar type found'
    else:
        bbox=host.get_BoundingBox(None)
        ptmin=bbox.Min
        ptmax=bbox.Max
        
        cover_ft=40.0/304.8
        
        xmin=ptmin.X+cover_ft
        xmax=ptmax.X-cover_ft
        ymin=ptmin.Y+cover_ft
        ymax=ptmax.Y-cover_ft
        zstart=ptmin.Z+cover_ft
        zend=ptmax.Z-cover_ft
        
        corners=[(xmin, ymin), (xmax, ymin), (xmax, ymax), (xmin, ymax)]
        
        created_rebar=[]
        
        TransactionManager.Instance.EnsureInTransaction(doc)
        norm=DB.XYZ(1,0,0)
        
        for cx, cy in corners:
            p1=DB.XYZ(cx, cy, zstart)
            p2=DB.XYZ(cx, cy, zend)
            
            barline=DB.Line.CreateBound(p1, p2)
            curves=List[DB.Curve]()
            curves.Add(barline)
            
            bar_termination=DBStruct.BarTerminationsData(doc)
            new_rebar=DBStruct.Rebar.CreateFromCurves(
            doc,
            DBStruct.RebarStyle.Standard,
            rebar_type,
            host,
            norm,
            curves,
            bar_termination,
            True,
            True
            )
            created_rebar.append(new_rebar.Id.ToString())
            
        TransactionManager.Instance.TransactionTaskDone()
        
        OUT='Success: Created 4 longitudinal rebars'
    
    
    
    
    
    
    
    
# ----------------------------------------
watch = Watch(python_script)
