# Dynamo graph 04_Generating_Stirrups.dyn "4rebarexercise" (Dynamo 4.0.2.3852)

select_model_element = DSModelElementSelection()  # 1 picked in the model
python_script = Python(IN[0]=select_model_element)  # PythonNet3
# ---------- python_script.python (76 lines) ----------
import clr
from System.Collections.Generic import List

clr.AddReference('RevitAPI')
import Autodesk.Revit.DB as DB
import Autodesk.Revit.DB.Structure as DBStruct

clr.AddReference('RevitServices')
from RevitServices.Persistence import DocumentManager
from RevitServices.Transactions import TransactionManager

doc=DocumentManager.Instance.CurrentDBDocument

host=UnwrapElement(IN[0])

if not host:
    OUT='Please Select rebar'
else:
    rebar_type=DB.FilteredElementCollector(doc) \
    .OfClass(DBStruct.RebarBarType) \
    .WhereElementIsElementType() \
    .FirstElement()
    
    bbox=host.get_BoundingBox(None)
    ptmin=bbox.Min
    ptmax=bbox.Max
    cover_ft=40.0/304.8
    
    xmin=ptmax.X+cover_ft
    xmax=ptmin.X-cover_ft
    ymin=ptmax.Y+cover_ft
    ymax=ptmin.Y-cover_ft
    
    zpos=ptmin.Z+cover_ft+(100.0/304.8)
    
    cp0=DB.XYZ(xmin, ymin, zpos)
    cp1=DB.XYZ(xmax, ymin, zpos)
    cp2=DB.XYZ(xmax, ymax, zpos)
    cp3=DB.XYZ(xmin, ymax, zpos)
    
    l1=DB.Line.CreateBound(cp0, cp1)
    l2=DB.Line.CreateBound(cp1, cp2)
    l3=DB.Line.CreateBound(cp2, cp3)
    l4=DB.Line.CreateBound(cp3, cp0)
    
    
    curves=List[DB.Curve]()
    curves.Add(l1)
    curves.Add(l2)
    curves.Add(l3)
    curves.Add(l4)
    
    norm=DB.XYZ(0,0,1)
    
    bar_terminate=DBStruct.BarTerminationsData(doc)
    TransactionManager.Instance.EnsureInTransaction(doc)
    
    stirrup_rebar=DBStruct.Rebar.CreateFromCurves(
    doc,
    DBStruct.RebarStyle.StirrupTie,
    rebar_type,
    host,
    norm,
    curves,
    bar_terminate,
    True,
    True
    )
    
    TransactionManager.Instance.TransactionTaskDone()
    
    OUT='Success: Created single stirrup'
    
    
    
  
# ----------------------------------------
watch = Watch(python_script)
