# Dynamo graph 05_Creating_Stirrup_Zone.dyn "5rebarexercise" (Dynamo 4.0.2.3852)

select_model_element = DSModelElementSelection()  # 1 picked in the model
python_script = Python(IN[0]=select_model_element)  # PythonNet3
# ---------- python_script.python (96 lines) ----------
import clr
from System.Collections.Generic import List

clr.AddReference('RevitAPI')
import Autodesk.Revit.DB as DB
import Autodesk.Revit.DB.Structure as DBStruct

clr.AddReference('RevitServices')
from RevitServices.Persistence import DocumentManager
from RevitServices.Transactions import TransactionManager

doc=DocumentManager.Instance.CurrentDBDocument

host=UnwrapElement(IN[0])

if not host:
    OUT='Please Select rebar'
else:
    rebar_type=DB.FilteredElementCollector(doc) \
    .OfClass(DBStruct.RebarBarType) \
    .WhereElementIsElementType() \
    .FirstElement()
    
    bbox=host.get_BoundingBox(None)
    ptmin=bbox.Min
    ptmax=bbox.Max
    cover_ft=40.0/304.8
    
    xmin=ptmin.X+cover_ft
    xmax=ptmax.X-cover_ft
    ymin=ptmin.Y+cover_ft
    ymax=ptmax.Y-cover_ft
    
    zstart=ptmin.Z+cover_ft
    zend=ptmax.Z-cover_ft
    totalht=zend-zstart
    
    densespace=100.0/304.8
    sparsespace=200.0/304.8
    
    zonelength=totalht*0.20
    
    zelevations=[]
    currentz=zstart
    
    while currentz <= zend:
        zelevations.append(currentz)
        inbottomzone=(currentz-zstart) <= zonelength
        intopzone=(zend-currentz) <= zonelength
        
        if inbottomzone or intopzone:
            currentz+=densespace
        else:
            currentz+=sparsespace
    
    
    TransactionManager.Instance.EnsureInTransaction(doc)
    
    createdstup=[]
    norm=DB.XYZ(0,0,1)
    
    for zpos in zelevations:
        cp0=DB.XYZ(xmin, ymin, zpos)
        cp1=DB.XYZ(xmax, ymin, zpos)
        cp2=DB.XYZ(xmax, ymax, zpos)
        cp3=DB.XYZ(xmin, ymax, zpos)
        
        l1=DB.Line.CreateBound(cp0, cp1)
        l2=DB.Line.CreateBound(cp1, cp2)
        l3=DB.Line.CreateBound(cp2, cp3)
        l4=DB.Line.CreateBound(cp3, cp0)
        
        curves=List[DB.Curve]()
        curves.Add(l1)
        curves.Add(l2)
        curves.Add(l3)
        curves.Add(l4)
        
        bar_terminate=DBStruct.BarTerminationsData(doc)
        stirrup_rebar=DBStruct.Rebar.CreateFromCurves(
        doc,
        DBStruct.RebarStyle.StirrupTie,
        rebar_type,
        host,
        norm,
        curves,
        bar_terminate,
        True,
        True
        )
        
        createdstup.append(stirrup_rebar.Id.ToString())
        
    TransactionManager.Instance.TransactionTaskDone()
    OUT='Success: Created multiple stirrup'
        
# ----------------------------------------
watch = Watch(python_script)
