# Dynamo graph 06_BBS_Calculation.dyn "6rebarexercise" (Dynamo 4.0.2.3852)

select_model_element = DSModelElementSelection()  # 1 picked in the model
python_script = Python(IN[0]=select_model_element)  # PythonNet3
# ---------- python_script.python (60 lines) ----------
import clr

clr.AddReference('RevitAPI')
import Autodesk.Revit.DB as DB
import Autodesk.Revit.DB.Structure as DBStruct

clr.AddReference('RevitServices')
from RevitServices.Persistence import DocumentManager

doc = DocumentManager.Instance.CurrentDBDocument

host = UnwrapElement(IN[0])

if not host:
    OUT = "Error: Select a concrete column in IN[0]"
else:
    rebar_collector = DB.FilteredElementCollector(doc) \
        .OfClass(DBStruct.Rebar) \
        .ToElements()

    host_rebars = [r for r in rebar_collector if r.GetHostId() == host.Id]

    if not host_rebars:
        OUT = "Error: No rebar found hosted in the selected column."
    else:
        bbs_data = []
        total_steel_weight_kg = 0.0
        
        for idx, rebar in enumerate(host_rebars, start=1):
            r_type = doc.GetElement(rebar.GetTypeId())
            type_name = r_type.Name if r_type else "Unknown"

            dia_ft = r_type.BarNominalDiameter if r_type else 0.0
            dia_mm = dia_ft * 304.8

            length_ft = rebar.TotalLength
            length_mm = length_ft * 304.8
            length_m = length_mm / 1000.0

            qty = rebar.Quantity

            unit_weight_kg_per_m = (dia_mm ** 2) / 162.0
            total_bar_weight_kg = length_m * qty * unit_weight_kg_per_m
            total_steel_weight_kg += total_bar_weight_kg

            record = "Rebar #{}: Type={}, Qty={}, Dia={:.1f}mm, Length={:.2f}m, Total Weight={:.2f}kg".format(
                idx,
                type_name,
                qty,
                dia_mm,
                length_m,
                total_bar_weight_kg
            )
            bbs_data.append(record)

        bbs_data.append("TOTAL STEEL WEIGHT FOR COLUMN: {:.2f} kg".format(total_steel_weight_kg))

        OUT = bbs_data
        
        
# ----------------------------------------
watch = Watch(python_script)
