# Dynamo graph Universal_Cage_Generator.dyn "7rebarfinalexercise" (Dynamo 4.0.2.3852)

select_model_element = DSModelElementSelection()  # 1 picked in the model
python_script = Python(IN[0]=select_model_element)  # PythonNet3
# ---------- python_script.python (234 lines) ----------
import clr
from System.Collections.Generic import List

clr.AddReference('RevitAPI')
import Autodesk.Revit.DB as DB
import Autodesk.Revit.DB.Structure as DBStruct

clr.AddReference('RevitServices')
from RevitServices.Persistence import DocumentManager
from RevitServices.Transactions import TransactionManager

doc = DocumentManager.Instance.CurrentDBDocument

host = UnwrapElement(IN[0])

if not host:
    OUT = 'Error: Please select a concrete column or beam'
else:
    host_data = DBStruct.RebarHostData.GetRebarHostData(host)

    if host_data is None or not host_data.IsValidHost():
        OUT = 'Selected element is not valid rebar host'
    else:
        rebar_type = DB.FilteredElementCollector(doc) \
            .OfClass(DBStruct.RebarBarType) \
            .WhereElementIsElementType() \
            .FirstElement()

        bbox = host.get_BoundingBox(None)
        ptmin = bbox.Min
        ptmax = bbox.Max

        dx = abs(ptmax.X - ptmin.X)
        dy = abs(ptmax.Y - ptmin.Y)
        dz = abs(ptmax.Z - ptmin.Z)

        iscol = dz > max(dx, dy)

        cover_ft = 40.0 / 304.8
        strup_dia = 10.0 / 304.8
        cover_main = cover_ft + strup_dia

        # Outer Stirrup Bounds
        xminst = ptmin.X + cover_ft
        xmaxst = ptmax.X - cover_ft
        yminst = ptmin.Y + cover_ft
        ymaxst = ptmax.Y - cover_ft  
        zminst = ptmin.Z + cover_ft
        zmaxst = ptmax.Z - cover_ft

        # Inner Main Bar Bounds
        xminm = ptmin.X + cover_main
        xmaxm = ptmax.X - cover_main
        yminm = ptmin.Y + cover_main
        ymaxm = ptmax.Y - cover_main
        zminm = ptmin.Z + cover_main
        zmaxm = ptmax.Z - cover_main

        dense = 100.0 / 304.8
        sparse = 200.0 / 304.8

        TransactionManager.Instance.EnsureInTransaction(doc)
        created_elements = []

        # =========================================================
        # COLUMN (Vertical)
        # =========================================================
        if iscol:
            cornerpts = [
                (xminm, yminm), (xmaxm, yminm), (xmaxm, ymaxm), (xminm, ymaxm)
            ]
            norm_main = DB.XYZ(1, 0, 0)

            for cx, cy in cornerpts:
                p1 = DB.XYZ(cx, cy, zminm)
                p2 = DB.XYZ(cx, cy, zmaxm)
                line = DB.Line.CreateBound(p1, p2)
                curves = List[DB.Curve]()
                curves.Add(line)

                bar_term = DBStruct.BarTerminationsData(doc)
                bar = DBStruct.Rebar.CreateFromCurves(
                    doc, DBStruct.RebarStyle.Standard, rebar_type,
                    host, norm_main, curves, bar_term, True, True
                )
                if bar:
                    created_elements.append(bar.Id.ToString())  

            total_len = zmaxst - zminst
            zone_len = total_len * 0.20
            curvez = zminst
            normst = DB.XYZ(0, 0, 1)

            while curvez <= zmaxst:
                cp0 = DB.XYZ(xminst, yminst, curvez)
                cp1 = DB.XYZ(xmaxst, yminst, curvez)
                cp2 = DB.XYZ(xmaxst, ymaxst, curvez)
                cp3 = DB.XYZ(xminst, ymaxst, curvez)

                l1 = DB.Line.CreateBound(cp0, cp1)
                l2 = DB.Line.CreateBound(cp1, cp2)
                l3 = DB.Line.CreateBound(cp2, cp3)
                l4 = DB.Line.CreateBound(cp3, cp0)

                stcurves = List[DB.Curve]()
                stcurves.Add(l1); stcurves.Add(l2); stcurves.Add(l3); stcurves.Add(l4)

                barterm = DBStruct.BarTerminationsData(doc)
                strup = DBStruct.Rebar.CreateFromCurves(
                    doc, DBStruct.RebarStyle.StirrupTie, rebar_type,
                    host, normst, stcurves, barterm, True, True
                )
                if strup:
                    created_elements.append(strup.Id.ToString())  
                
                in_end_zone = (curvez - zminst) <= zone_len or (zmaxst - curvez) <= zone_len
                curvez += dense if in_end_zone else sparse 

        # =========================================================
        # BEAM (Horizontal)
        # =========================================================
        else:
            alongx = dx >= dy

            # --- BEAM ALIGNED WITH X-AXIS ---
            if alongx:
                cornerpts = [
                    (yminm, zminm), (ymaxm, zminm), (ymaxm, zmaxm), (yminm, zmaxm)
                ]
                norm_main = DB.XYZ(0, 1, 0)

                for cy, cz in cornerpts:
                    p1 = DB.XYZ(xminm, cy, cz)
                    p2 = DB.XYZ(xmaxm, cy, cz)
                    line = DB.Line.CreateBound(p1, p2)
                    curves = List[DB.Curve]()
                    curves.Add(line)

                    bar_term = DBStruct.BarTerminationsData(doc)
                    bar = DBStruct.Rebar.CreateFromCurves(
                        doc, DBStruct.RebarStyle.Standard, rebar_type,
                        host, norm_main, curves, bar_term, True, True
                    )
                    if bar:
                        created_elements.append(bar.Id.ToString())

                totallen = xmaxst - xminst  
                zonelen = totallen * 0.20
                currx = xminst
                normst = DB.XYZ(1, 0, 0)

                while currx <= xmaxst:
                    cp0 = DB.XYZ(currx, yminst, zminst)
                    cp1 = DB.XYZ(currx, ymaxst, zminst)
                    cp2 = DB.XYZ(currx, ymaxst, zmaxst)
                    cp3 = DB.XYZ(currx, yminst, zmaxst)

                    l1 = DB.Line.CreateBound(cp0, cp1)
                    l2 = DB.Line.CreateBound(cp1, cp2)
                    l3 = DB.Line.CreateBound(cp2, cp3)
                    l4 = DB.Line.CreateBound(cp3, cp0)

                    stcurves = List[DB.Curve]()
                    stcurves.Add(l1); stcurves.Add(l2); stcurves.Add(l3); stcurves.Add(l4)

                    bar_term = DBStruct.BarTerminationsData(doc)
                    strup = DBStruct.Rebar.CreateFromCurves(
                        doc, DBStruct.RebarStyle.StirrupTie, rebar_type,
                        host, normst, stcurves, bar_term, True, True
                    )
                    if strup:
                        created_elements.append(strup.Id.ToString())

                    in_end_zone = (currx - xminst) <= zonelen or (xmaxst - currx) <= zonelen
                    currx += dense if in_end_zone else sparse

            # --- BEAM ALIGNED WITH Y-AXIS ---
            else:
                cornerpts = [
                    (xminm, zminm), (xmaxm, zminm), (xmaxm, zmaxm), (xminm, zmaxm)
                ]
                norm_main = DB.XYZ(1, 0, 0)

                for cx, cz in cornerpts:
                    p1 = DB.XYZ(cx, yminm, cz)
                    p2 = DB.XYZ(cx, ymaxm, cz)
                    line = DB.Line.CreateBound(p1, p2)
                    curves = List[DB.Curve]()
                    curves.Add(line)

                    bar_term = DBStruct.BarTerminationsData(doc)
                    bar = DBStruct.Rebar.CreateFromCurves(
                        doc, DBStruct.RebarStyle.Standard, rebar_type,
                        host, norm_main, curves, bar_term, True, True
                    )
                    if bar:
                        created_elements.append(bar.Id.ToString())

                totallen = ymaxst - yminst  
                zonelen = totallen * 0.20
                curry = yminst
                normst = DB.XYZ(0, 1, 0)

                while curry <= ymaxst:
                    cp0 = DB.XYZ(xminst, curry, zminst)
                    cp1 = DB.XYZ(xmaxst, curry, zminst)
                    cp2 = DB.XYZ(xmaxst, curry, zmaxst)
                    cp3 = DB.XYZ(xminst, curry, zmaxst)

                    l1 = DB.Line.CreateBound(cp0, cp1)
                    l2 = DB.Line.CreateBound(cp1, cp2)
                    l3 = DB.Line.CreateBound(cp2, cp3)
                    l4 = DB.Line.CreateBound(cp3, cp0)

                    stcurves = List[DB.Curve]()
                    stcurves.Add(l1); stcurves.Add(l2); stcurves.Add(l3); stcurves.Add(l4)

                    bar_term = DBStruct.BarTerminationsData(doc)
                    strup = DBStruct.Rebar.CreateFromCurves(
                        doc, DBStruct.RebarStyle.StirrupTie, rebar_type,
                        host, normst, stcurves, bar_term, True, True
                    )
                    if strup:
                        created_elements.append(strup.Id.ToString())

                    in_end_zone = (curry - yminst) <= zonelen or (ymaxst - curry) <= zonelen
                    curry += dense if in_end_zone else sparse

        TransactionManager.Instance.TransactionTaskDone()

        element_type = 'COLUMN' if iscol else 'BEAM'
        OUT = "Success: Generated 3D rebar cage for {}! Total Elements: {}".format(
            element_type, len(created_elements)
        )
# ----------------------------------------
watch = Watch(python_script)
